vi "DCVRATIOGUI_eventcontrol.gvi"   [LabVIEW NXG 5.1.0]
panel controls:
  "VoltageDC_control": bool
  "VoltageAC_control": bool
  "CurrentDC_control": bool
  "CurrentAC_control": bool
  "stop": bool
  "Auto Range_DCV": bool = TRUE
  "Auto Zero_DCV": bool = TRUE
  "Aperture NPLC_DCV": f64 = "10 PLC"(10)
  "Aperture Time_DCV": f64 = 0.1
  "Aperture_DCV": bool = TRUE
  "Manual Range_DCV": f64 = "1 V"(1)
  "Auto Range_DCVR": bool = TRUE
  "Manual Range_DCVR": f64 = "1 V"(1)
  "Aperture_DCVR": bool = TRUE
  "Aperture NPLC_DCVR": f64 = "10 PLC"(10)
  "Manual Range_ACV": f64 = "1 V"(1)
  "VoltageBandwidth_ACV": i32 = 1
  "Auto Range_ACV": bool = TRUE
  "Auto Range_DCC": bool = TRUE
  "Manual Range_DCC": f64 = "1 A"(1)
  "TerminalType_DCC": i32 = 1
  "Aperture_DCC": bool = TRUE
  "Aperture NPLC_DCC": f64 = "10 PLC"(10)
  "Auto Zero_DCC": bool = TRUE
  "TerminalType_ACC": i32 = 1
  "Auto Range_ACC": bool = TRUE
  "Manual Range_ACC": f64 = "1 A"(1)
  "VoltageBandwidth_ACC": i32 = 1
panel indicators:
  "VoltageDC_indicator": bool
  "VoltageAC_indicator": bool
  "CurrentDC_indicator": bool
  "CurrentAC_indicator": bool
  "DCV Ratio_toenable": bool
  "Auto Impedance_DCV": bool
  "DIG Option On/Off_DCV": bool
  "String_DCV": string
  "String_DCVR": string
  "DIG Option On/Off_DCVR": bool
  "Aperture Time_DCVR": f64
  "DCV Ratio_todisable": bool
  "Auto Impedance_DCVR": bool
  "String_ACV": string
  "Aperture Time_DCC": f64
  "String_DCC": string
  "String_ACC": string
diagram:
  # BUTTONS VISIBILITY
  Property Node(instance in=reference to "VoltageAC_control", "Visible"=TRUE, "Disabled"=FALSE)
  Property Node(instance in=reference to "CurrentDC_control", "Visible"=TRUE, "Disabled"=FALSE)
  Property Node(instance in=reference to "CurrentAC_control", "Visible"=TRUE, "Disabled"=FALSE)
  Property Node(instance in=reference to "VoltageDC_indicator", "Visible"=FALSE)
  # MAIN DEFAULTS
  $stop <- FALSE
  Property Node(instance in=reference to "VoltageDC_control", "Visible"=TRUE, "Disabled"=FALSE)
  $VoltageAC_control <- FALSE
  Property Node(instance in=reference to "VoltageAC_indicator", "Visible"=FALSE)
  Property Node(instance in=reference to "CurrentDC_indicator", "Visible"=FALSE)
  Property Node(instance in=reference to "CurrentAC_indicator", "Visible"=FALSE, "Disabled"=FALSE)
  $VoltageDC_control <- FALSE
  $CurrentDC_control <- FALSE
  $CurrentAC_control <- FALSE
  # TITLES VISIBILITY
  Property Node(instance in=reference to unnamed text, "Visible"=TRUE)
  Property Node(instance in=reference to unnamed text, "Visible"=FALSE)
  Property Node(instance in=reference to unnamed text, "Visible"=FALSE)
  # DCV DEFAULTS
  $"Auto Range_DCV" <- TRUE
  # DCC DEFAULTS
  # DCC VISIBILITY
  Property Node(instance in=reference to "TerminalType_DCC", "Visible"=FALSE)
  Property Node(instance in=reference to unnamed text, "Visible"=FALSE)
  $"Auto Zero_DCV" <- TRUE
  # DCVRATIO VISIBILITY
  Property Node(instance in=reference to "DIG Option On/Off_DCVR", "Visible"=FALSE)
  # DCV VISIBILITY
  Property Node(instance in=reference to "DIG Option On/Off_DCV", "Visible"=FALSE)
  # ACC DEFAULTS
  # ACC VISIBILITY
  Property Node(instance in=reference to "TerminalType_ACC", "Visible"=FALSE)
  $"DIG Option On/Off_DCV" <- TRUE
  Property Node(instance in=reference to "Auto Range_DCC", "Visible"=FALSE)
  $Aperture_DCV <- TRUE
  Property Node(instance in=reference to "Auto Impedance_DCVR", "Visible"=FALSE)
  Property Node(instance in=reference to "Auto Impedance_DCV", "Visible"=FALSE)
  Property Node(instance in=reference to unnamed text, "Visible"=FALSE)
  Property Node(instance in=reference to "VoltageBandwidth_ACC", "Visible"=FALSE)
  $"DCV Ratio_toenable" <- FALSE
  Property Node(instance in=reference to "Manual Range_DCC", "Visible"=FALSE)
  $"Auto Impedance_DCV" <- FALSE
  Property Node(instance in=reference to "Manual Range_DCVR", "Visible"=FALSE)
  Property Node(instance in=reference to "Manual Range_DCV", "Visible"=FALSE, "Disabled"=TRUE)
  Property Node(instance in=reference to unnamed text, "Visible"=FALSE)
  Property Node(instance in=reference to "Manual Range_ACC", "Visible"=FALSE)
  Property Node(instance in=reference to "Aperture_DCC", "Visible"=FALSE)
  Property Node(instance in=reference to "Aperture NPLC_DCVR", "Visible"=FALSE)
  Property Node(instance in=reference to "Aperture NPLC_DCV", "Visible"=FALSE)
  Property Node(instance in=reference to "Auto Range_ACC", "Visible"=FALSE)
  Property Node(instance in=reference to "Aperture NPLC_DCC", "Visible"=FALSE)
  Property Node(instance in=reference to "Aperture_DCVR", "Visible"=FALSE)
  Property Node(instance in=reference to "Aperture_DCV", "Visible"=FALSE)
  Property Node(instance in=reference to "String_ACC", "Visible"=FALSE)
  Property Node(instance in=reference to "Aperture Time_DCC", "Visible"=FALSE)
  Property Node(instance in=reference to "Auto Range_DCVR", "Visible"=FALSE)
  Property Node(instance in=reference to "Auto Range_DCV", "Visible"=FALSE)
  Property Node(instance in=reference to "Auto Zero_DCC", "Visible"=FALSE)
  Property Node(instance in=reference to "DCV Ratio_todisable", "Visible"=FALSE)
  Property Node(instance in=reference to "DCV Ratio_toenable", "Visible"=FALSE)
  Property Node(instance in=reference to "Aperture Time_DCVR", "Visible"=FALSE)
  Property Node(instance in=reference to "Aperture Time_DCV", "Visible"=FALSE)
  # DCVRATIO DEFAULTS
  $"Auto Range_DCVR" <- TRUE
  Property Node(instance in=reference to "String_DCC", "Visible"=FALSE)
  $Aperture_DCVR <- TRUE
  Property Node(instance in=reference to "String_DCVR", "Visible"=FALSE)
  Property Node(instance in=reference to "String_DCV", "Visible"=FALSE)
  $"DIG Option On/Off_DCVR" <- TRUE
  $"DCV Ratio_todisable" <- FALSE
  Property Node(instance in=reference to "Auto Zero_DCV", "Visible"=FALSE)
  $"Auto Impedance_DCVR" <- FALSE
  # ACV DEFAULTS
  # ACV VISIBILITY
  Property Node(instance in=reference to "Manual Range_ACV", "Visible"=FALSE)
  Property Node(instance in=reference to "VoltageBandwidth_ACV", "Visible"=FALSE)
  Property Node(instance in=reference to "String_ACV", "Visible"=FALSE)
  Property Node(instance in=reference to "Auto Range_ACV", "Visible"=FALSE)
  while {
    $CurrentAC_indicator <- $CurrentAC_control
    event {
      on "VoltageDC_control" Value changed {
        Property Node(instance in=reference to unnamed text, "Visible"=FALSE)
        # ACC VISIBILITY
        Property Node(instance in=reference to "String_DCC", "Visible"=FALSE)
        Property Node(instance in=reference to unnamed text, "Visible"=FALSE)
        Property Node(instance in=reference to "TerminalType_DCC", "Visible"=FALSE)
        Property Node(instance in=reference to "Auto Range_DCC", "Visible"=FALSE)
        Property Node(instance in=reference to "TerminalType_ACC", "Visible"=FALSE)
        Property Node(instance in=reference to "Manual Range_DCC", "Visible"=FALSE)
        Property Node(instance in=reference to "VoltageBandwidth_ACC", "Visible"=FALSE)
        Property Node(instance in=reference to "Aperture_DCC", "Visible"=FALSE)
        Property Node(instance in=reference to "Manual Range_ACC", "Visible"=FALSE)
        Property Node(instance in=reference to "Aperture NPLC_DCC", "Visible"=FALSE)
        Property Node(instance in=reference to "Auto Range_ACC", "Visible"=FALSE)
        Property Node(instance in=reference to "Aperture Time_DCC", "Visible"=FALSE)
        Property Node(instance in=reference to "String_ACC", "Visible"=FALSE)
        Property Node(instance in=reference to "Manual Range_ACV", "Visible"=FALSE)
        Property Node(instance in=reference to "Auto Zero_DCC", "Visible"=FALSE)
        Property Node(instance in=reference to "VoltageBandwidth_ACV", "Visible"=FALSE)
        Property Node(instance in=reference to "String_ACV", "Visible"=FALSE)
        Property Node(instance in=reference to "Auto Range_ACV", "Visible"=FALSE)
        Property Node(instance in=reference to unnamed text, "Visible"=TRUE)
        Event Data() -> ("Old Value"=w2, "New Value"=w3)
        Property Node(instance in=reference to "CurrentDC_control", "Visible"=w3, "Value"=FALSE)
        Property Node(instance in=reference to "VoltageDC_control", "Visible"=w2)
        Property Node(instance in=reference to "CurrentAC_control", "Visible"=w3, "Value"=FALSE)
        Property Node(instance in=reference to "VoltageDC_indicator", "Visible"=w3)
        Property Node(instance in=reference to "CurrentDC_indicator", "Visible"=w2)
        Property Node(instance in=reference to "DIG Option On/Off_DCVR", "Visible"=FALSE)
        Property Node(instance in=reference to "VoltageAC_control", "Visible"=w3, "Value"=FALSE)
        Property Node(instance in=reference to "Auto Impedance_DCVR", "Visible"=FALSE)
        Property Node(instance in=reference to "VoltageAC_indicator", "Visible"=w2)
        Property Node(instance in=reference to "Manual Range_DCVR", "Visible"=FALSE)
        Property Node(instance in=reference to "CurrentAC_indicator", "Visible"=w2)
        Property Node(instance in=reference to "Aperture NPLC_DCVR", "Visible"=FALSE)
        Property Node(instance in=reference to "Manual Range_DCV", "Visible"=TRUE)
        Property Node(instance in=reference to "Aperture_DCVR", "Visible"=FALSE)
        Property Node(instance in=reference to "Aperture NPLC_DCV", "Visible"=TRUE)
        Property Node(instance in=reference to "Auto Range_DCVR", "Visible"=FALSE)
        Property Node(instance in=reference to "Aperture Time_DCV", "Visible"=TRUE)
        Property Node(instance in=reference to "DCV Ratio_todisable", "Visible"=FALSE)
        Property Node(instance in=reference to "Aperture Time_DCVR", "Visible"=FALSE)
        Property Node(instance in=reference to "String_DCV", "Visible"=TRUE)
        Property Node(instance in=reference to "String_DCVR", "Visible"=FALSE)
        Property Node(instance in=reference to "Auto Range_DCV", "Visible"=TRUE)
        Property Node(instance in=reference to "DCV Ratio_toenable", "Visible"=TRUE)
        Property Node(instance in=reference to "Auto Impedance_DCV", "Visible"=TRUE)
        Property Node(instance in=reference to "Auto Zero_DCV", "Visible"=TRUE)
        Property Node(instance in=reference to "DIG Option On/Off_DCV", "Visible"=TRUE)
        Property Node(instance in=reference to unnamed text, "Visible"=FALSE)
        Property Node(instance in=reference to unnamed text, "Visible"=FALSE)
        Property Node(instance in=reference to unnamed text, "Visible"=FALSE)
        Property Node(instance in=reference to "Aperture_DCV", "Visible"=TRUE)
        w1 = default
      }
      on "Aperture NPLC_DCV" Value changed; "Aperture Time_DCV" Value changed; "Aperture_DCV" Value changed; "Auto Impedance_DCV" Value changed; "Auto Range_DCV" Value changed; "Auto Zero_DCV" Value changed; "DIG Option On/Off_DCV" Value changed; "Manual Range_DCV" Value changed {
        Property Node(instance in=reference to "Aperture_DCV") -> ("Value"=w4)
        Property Node(instance in=reference to "DIG Option On/Off_DCV") -> ("Value"=w5)
        case (w5) {
          frame False, Default {
            w6 = [0, 1, 2]
          }
          frame True {
            w6 = i32[] []
          }
        }
        Not(x=w4) -> w7
        Property Node(instance in=reference to "Aperture NPLC_DCV", "Disabled"=w7, "DisabledIndexes"=w6) -> ("Value"=w8)
        case (w5) {
          frame False, Default {
            w9 = 0.0002
          }
          frame True {
            w9 = 2e-05
          }
        }
        Property Node(instance in=reference to "Aperture Time_DCV", "Disabled"=w4, "Minimum"=w9) -> ("Value"=w10)
        Quotient And Remainder(x=w10, y=2e-06) -> (floor(x/y)=w11, x-y*floor(x/y)=w12)
        Multiply(w12, 1000000) -> w13
        Round To Nearest(number=w13) -> w14
        To Signed 32 Bit Integer(number=w14) -> w15
        case (w15) {
          frame 0, Default {
            Multiply(2e-06, w11) -> w16
          }
          frame 1 {
            Multiply(2e-06, w11) -> w16
          }
          frame 2 {
            Add(1, w11) -> w17
            Multiply(2e-06, w17) -> w16
          }
        }
        case (w4) {
          frame False, Default {
            Format Into String(formatString="%_6ps", initString="Aperture Time: ", w16) -> w18
          }
          frame True {
            Format Into String(formatString="%#gPLC", initString="Aperture NPLC: ", w8) -> w18
          }
        }
        Property Node(instance in=reference to "Auto Range_DCV") -> ("Value"=w19)
        Property Node(instance in=reference to "Manual Range_DCV", "Disabled"=w19) -> ("Value"=w20)
        case (w19) {
          frame False, Default {
            Format Into String(formatString="%.0pV", initString="Range: ", w20) -> w21
          }
          frame True {
            w21 = "Range: Auto"
          }
        }
        Property Node(instance in=reference to "Auto Impedance_DCV") -> ("Value"=w22)
        case (w22) {
          frame False, Default {
            w23 = "Input Z: 10MΩ"
          }
          frame True {
            w23 = "Input Z: Auto"
          }
        }
        Property Node(instance in=reference to "Auto Zero_DCV") -> ("Value"=w24)
        case (w24) {
          frame False, Default {
            w25 = "Auto Zero: Off"
          }
          frame True {
            w25 = "Auto Zero: On"
          }
        }
        Concatenate Strings("Your settings:", "\r\n", w21, "\r\n", w18, "\r\n", w25, "\r\n", w23, "\r\n", "DCV Ratio: Off") -> w26
        $String_DCV <- w26
        Property Node(instance in=reference to "Aperture Time_DCV", "Value"=w16)
        w1 = default
      }
      on "DCV Ratio_toenable" Value changed {
        Property Node(instance in=reference to "Auto Range_DCV", "Visible"=FALSE)
        Property Node(instance in=reference to "String_DCV", "Visible"=FALSE)
        Property Node(instance in=reference to "DIG Option On/Off_DCVR", "Visible"=TRUE)
        Property Node(instance in=reference to "Auto Zero_DCV", "Visible"=FALSE)
        Property Node(instance in=reference to "Auto Impedance_DCVR", "Visible"=TRUE)
        Property Node(instance in=reference to "Manual Range_DCVR", "Visible"=TRUE)
        Property Node(instance in=reference to "Aperture NPLC_DCVR", "Visible"=TRUE)
        Property Node(instance in=reference to "Aperture_DCV", "Visible"=FALSE)
        Property Node(instance in=reference to "Aperture_DCVR", "Visible"=TRUE)
        Property Node(instance in=reference to unnamed text, "Visible"=FALSE)
        Property Node(instance in=reference to "Auto Range_DCVR", "Visible"=TRUE)
        Property Node(instance in=reference to "DCV Ratio_toenable", "Visible"=FALSE)
        Property Node(instance in=reference to "DCV Ratio_todisable", "Visible"=TRUE)
        Property Node(instance in=reference to unnamed text, "Visible"=TRUE)
        Property Node(instance in=reference to "Aperture Time_DCVR", "Visible"=TRUE)
        Property Node(instance in=reference to "Manual Range_DCV", "Visible"=FALSE)
        Property Node(instance in=reference to "String_DCVR", "Visible"=TRUE)
        Property Node(instance in=reference to unnamed text, "Visible"=FALSE)
        Event Data() -> ("New Value"=w27)
        Property Node(instance in=reference to "DCV Ratio_todisable", "Visible"=w27, "Value"=w27)
        Property Node(instance in=reference to "Aperture NPLC_DCV", "Visible"=FALSE)
        Property Node(instance in=reference to "VoltageAC_indicator", "Visible"=FALSE)
        Property Node(instance in=reference to "DCV Ratio_toenable", "Visible"=FALSE)
        Property Node(instance in=reference to unnamed text, "Visible"=FALSE)
        Property Node(instance in=reference to "DIG Option On/Off_DCV", "Visible"=FALSE)
        Property Node(instance in=reference to "Aperture Time_DCV", "Visible"=FALSE)
        Property Node(instance in=reference to "Auto Impedance_DCV", "Visible"=FALSE)
        w1 = default
      }
      on "DCV Ratio_todisable" Value changed {
        Property Node(instance in=reference to "Auto Range_DCV", "Visible"=TRUE)
        Property Node(instance in=reference to "String_DCV", "Visible"=TRUE)
        Property Node(instance in=reference to "DIG Option On/Off_DCVR", "Visible"=FALSE)
        Property Node(instance in=reference to "DIG Option On/Off_DCV", "Visible"=TRUE)
        Property Node(instance in=reference to "Auto Zero_DCV", "Visible"=TRUE)
        Property Node(instance in=reference to "Auto Impedance_DCVR", "Visible"=FALSE)
        Property Node(instance in=reference to "Aperture Time_DCV", "Visible"=TRUE)
        Property Node(instance in=reference to "Manual Range_DCVR", "Visible"=FALSE)
        Property Node(instance in=reference to "Aperture NPLC_DCVR", "Visible"=FALSE)
        Property Node(instance in=reference to "Aperture_DCV", "Visible"=TRUE)
        Property Node(instance in=reference to "Aperture_DCVR", "Visible"=FALSE)
        Property Node(instance in=reference to unnamed text, "Visible"=FALSE)
        Property Node(instance in=reference to "Auto Range_DCVR", "Visible"=FALSE)
        Property Node(instance in=reference to "DCV Ratio_todisable", "Visible"=FALSE)
        Property Node(instance in=reference to unnamed text, "Visible"=FALSE)
        Property Node(instance in=reference to "Aperture Time_DCVR", "Visible"=FALSE)
        Property Node(instance in=reference to "Manual Range_DCV", "Visible"=TRUE)
        Property Node(instance in=reference to "String_DCVR", "Visible"=FALSE)
        Property Node(instance in=reference to unnamed text, "Visible"=TRUE)
        Property Node(instance in=reference to "Aperture NPLC_DCV", "Visible"=TRUE)
        Event Data() -> ("New Value"=w28)
        Property Node(instance in=reference to "DCV Ratio_toenable", "Visible"=TRUE, "Value"=w28)
        Property Node(instance in=reference to "Auto Impedance_DCV", "Visible"=TRUE)
        w1 = default
      }
      on "Aperture NPLC_DCVR" Value changed; "Aperture Time_DCVR" Value changed; "Aperture_DCVR" Value changed; "Auto Impedance_DCVR" Value changed; "Auto Range_DCVR" Value changed; "DIG Option On/Off_DCVR" Value changed; "Manual Range_DCVR" Value changed {
        Property Node(instance in=reference to "Aperture_DCVR") -> ("Value"=w29)
        Property Node(instance in=reference to "DIG Option On/Off_DCVR") -> ("Value"=w30)
        case (w30) {
          frame False, Default {
            w31 = [0, 1, 2]
          }
          frame True {
            w31 = i32[] []
          }
        }
        Not(x=w29) -> w32
        Property Node(instance in=reference to "Aperture NPLC_DCVR", "Disabled"=w32, "DisabledIndexes"=w31) -> ("Value"=w33)
        case (w30) {
          frame False, Default {
            w34 = 0.0002
          }
          frame True {
            w34 = 2e-05
          }
        }
        Property Node(instance in=reference to "Aperture Time_DCVR", "Disabled"=w29, "Minimum"=w34) -> ("Value"=w35)
        Quotient And Remainder(x=w35, y=2e-06) -> (floor(x/y)=w36, x-y*floor(x/y)=w37)
        Multiply(w37, 1000000) -> w38
        Round To Nearest(number=w38) -> w39
        To Signed 32 Bit Integer(number=w39) -> w40
        case (w40) {
          frame 0, Default {
            Multiply(2e-06, w36) -> w41
          }
          frame 1 {
            Multiply(2e-06, w36) -> w41
          }
          frame 2 {
            Add(1, w36) -> w42
            Multiply(2e-06, w42) -> w41
          }
        }
        case (w29) {
          frame False, Default {
            Format Into String(formatString="%_6ps", initString="Aperture Time: ", w41) -> w43
          }
          frame True {
            Format Into String(formatString="%#gPLC", initString="Aperture NPLC: ", w33) -> w43
          }
        }
        Property Node(instance in=reference to "Auto Range_DCVR") -> ("Value"=w44)
        Property Node(instance in=reference to "Manual Range_DCVR", "Disabled"=w44) -> ("Value"=w45)
        case (w44) {
          frame False, Default {
            Format Into String(formatString="%.0pV", initString="Range: ", w45) -> w46
          }
          frame True {
            w46 = "Range: Auto"
          }
        }
        Property Node(instance in=reference to "Auto Impedance_DCVR") -> ("Value"=w47)
        case (w47) {
          frame False, Default {
            w48 = "Input Z: 10MΩ"
          }
          frame True {
            w48 = "Input Z: Auto"
          }
        }
        Concatenate Strings("Your settings:", "\r\n", w46, "\r\n", w43, "\r\n", "Auto Zero cannot be disabled during DCV Ratio", "\r\n", w48, "\r\n", "DCV Ratio: On") -> w49
        $String_DCVR <- w49
        Property Node(instance in=reference to "Aperture Time_DCVR", "Value"=w41)
        w1 = default
      }
      on "VoltageAC_control" Value changed {
        Property Node(instance in=reference to unnamed text, "Visible"=FALSE)
        Property Node(instance in=reference to unnamed text, "Visible"=FALSE)
        Property Node(instance in=reference to "TerminalType_DCC", "Visible"=FALSE)
        Property Node(instance in=reference to "Auto Range_DCC", "Visible"=FALSE)
        Property Node(instance in=reference to "Manual Range_DCC", "Visible"=FALSE)
        Property Node(instance in=reference to "String_DCC", "Visible"=FALSE)
        Property Node(instance in=reference to "Aperture_DCC", "Visible"=FALSE)
        Property Node(instance in=reference to "Aperture NPLC_DCC", "Visible"=FALSE)
        # ACC VISIBILITY
        Property Node(instance in=reference to "TerminalType_ACC", "Visible"=FALSE)
        Property Node(instance in=reference to "Aperture Time_DCC", "Visible"=FALSE)
        Property Node(instance in=reference to "VoltageBandwidth_ACC", "Visible"=FALSE)
        Property Node(instance in=reference to "Auto Zero_DCC", "Visible"=FALSE)
        Property Node(instance in=reference to "Manual Range_ACC", "Visible"=FALSE)
        Property Node(instance in=reference to "Manual Range_ACV", "Visible"=TRUE)
        Property Node(instance in=reference to "Auto Range_ACC", "Visible"=FALSE)
        Property Node(instance in=reference to "VoltageBandwidth_ACV", "Visible"=TRUE)
        Property Node(instance in=reference to "String_ACC", "Visible"=FALSE)
        Property Node(instance in=reference to "String_ACV", "Visible"=TRUE)
        Property Node(instance in=reference to "Auto Range_ACV", "Visible"=TRUE)
        Property Node(instance in=reference to "Aperture_DCV", "Visible"=FALSE)
        Event Data() -> ("Old Value"=w50, "New Value"=w51)
        Property Node(instance in=reference to "VoltageDC_control", "Visible"=w51, "Value"=FALSE)
        Property Node(instance in=reference to unnamed text, "Visible"=w51)
        Property Node(instance in=reference to "VoltageAC_control", "Visible"=w50)
        Property Node(instance in=reference to "CurrentAC_control", "Visible"=w51, "Value"=FALSE)
        Property Node(instance in=reference to "CurrentDC_indicator", "Visible"=w50)
        Property Node(instance in=reference to "DIG Option On/Off_DCVR", "Visible"=FALSE)
        Property Node(instance in=reference to "CurrentDC_control", "Visible"=w51, "Value"=FALSE)
        Property Node(instance in=reference to "Auto Impedance_DCVR", "Visible"=FALSE)
        Property Node(instance in=reference to "CurrentAC_indicator", "Visible"=w50)
        Property Node(instance in=reference to "Manual Range_DCVR", "Visible"=FALSE)
        Property Node(instance in=reference to "VoltageDC_indicator", "Visible"=w50)
        Property Node(instance in=reference to "Aperture NPLC_DCVR", "Visible"=FALSE)
        Property Node(instance in=reference to "VoltageAC_indicator", "Visible"=w51)
        Property Node(instance in=reference to "Aperture_DCVR", "Visible"=FALSE)
        Property Node(instance in=reference to "Auto Range_DCVR", "Visible"=FALSE)
        Property Node(instance in=reference to "DCV Ratio_toenable", "Visible"=FALSE)
        Property Node(instance in=reference to "DCV Ratio_todisable", "Visible"=FALSE)
        Property Node(instance in=reference to "Aperture NPLC_DCV", "Visible"=FALSE)
        Property Node(instance in=reference to "Aperture Time_DCVR", "Visible"=FALSE)
        Property Node(instance in=reference to "Aperture Time_DCV", "Visible"=FALSE)
        Property Node(instance in=reference to "String_DCVR", "Visible"=FALSE)
        Property Node(instance in=reference to "String_DCV", "Visible"=FALSE)
        Property Node(instance in=reference to "Auto Range_DCV", "Visible"=FALSE)
        Property Node(instance in=reference to unnamed text, "Visible"=FALSE)
        Property Node(instance in=reference to "Auto Impedance_DCV", "Visible"=FALSE)
        Property Node(instance in=reference to "Auto Zero_DCV", "Visible"=FALSE)
        Property Node(instance in=reference to "DIG Option On/Off_DCV", "Visible"=FALSE)
        Property Node(instance in=reference to unnamed text, "Visible"=FALSE)
        Property Node(instance in=reference to unnamed text, "Visible"=FALSE)
        Property Node(instance in=reference to "Manual Range_DCV", "Visible"=FALSE)
        w1 = default
      }
      on "Auto Range_ACV" Value changed; "Manual Range_ACV" Value changed; "VoltageBandwidth_ACV" Value changed {
        Property Node(instance in=reference to "Auto Range_ACV") -> ("Value"=w52)
        Property Node(instance in=reference to "Manual Range_ACV", "Disabled"=w52) -> ("Value"=w53)
        case (w52) {
          frame False, Default {
            Format Into String(formatString="%.0pV", initString="Range: ", w53) -> w54
          }
          frame True {
            w54 = "Range: Auto"
          }
        }
        Property Node(instance in=reference to "VoltageBandwidth_ACV") -> ("Value"=w55)
        Format Into String(formatString="%.0pHz", initString="AC Filter: >", w55) -> w56
        Concatenate Strings("Your settings:", "\r\n", w54, "\r\n", w56) -> w57
        $String_ACV <- w57
        w1 = default
      }
      on "CurrentDC_control" Value changed {
        Property Node(instance in=reference to "DIG Option On/Off_DCV", "Visible"=FALSE)
        Property Node(instance in=reference to unnamed text, "Visible"=FALSE)
        Property Node(instance in=reference to "Auto Impedance_DCV", "Visible"=FALSE)
        Property Node(instance in=reference to unnamed text, "Visible"=TRUE)
        Property Node(instance in=reference to "Manual Range_DCV", "Visible"=FALSE)
        Property Node(instance in=reference to unnamed text, "Visible"=FALSE)
        Property Node(instance in=reference to "Aperture NPLC_DCV", "Visible"=FALSE)
        Property Node(instance in=reference to unnamed text, "Visible"=FALSE)
        Property Node(instance in=reference to "DIG Option On/Off_DCVR", "Visible"=FALSE)
        Property Node(instance in=reference to "Aperture_DCV", "Visible"=FALSE)
        Property Node(instance in=reference to unnamed text, "Visible"=FALSE)
        Property Node(instance in=reference to "String_DCC", "Visible"=TRUE)
        Property Node(instance in=reference to "Auto Impedance_DCVR", "Visible"=FALSE)
        Property Node(instance in=reference to "Auto Range_DCV", "Visible"=FALSE)
        Property Node(instance in=reference to unnamed text, "Visible"=FALSE)
        Property Node(instance in=reference to "Manual Range_DCVR", "Visible"=FALSE)
        Property Node(instance in=reference to "DCV Ratio_toenable", "Visible"=FALSE)
        Property Node(instance in=reference to "Aperture NPLC_DCVR", "Visible"=FALSE)
        Property Node(instance in=reference to "Aperture Time_DCV", "Visible"=FALSE)
        # ACC VISIBILITY
        Property Node(instance in=reference to "TerminalType_ACC", "Visible"=FALSE)
        Property Node(instance in=reference to "Aperture_DCVR", "Visible"=FALSE)
        Property Node(instance in=reference to "String_DCV", "Visible"=FALSE)
        Property Node(instance in=reference to "VoltageBandwidth_ACC", "Visible"=FALSE)
        Property Node(instance in=reference to "Auto Range_DCVR", "Visible"=FALSE)
        Property Node(instance in=reference to "Auto Zero_DCV", "Visible"=FALSE)
        Property Node(instance in=reference to "Manual Range_ACC", "Visible"=FALSE)
        Property Node(instance in=reference to "Manual Range_ACV", "Visible"=FALSE)
        Property Node(instance in=reference to "DCV Ratio_todisable", "Visible"=FALSE)
        Property Node(instance in=reference to "Auto Range_ACC", "Visible"=FALSE)
        Property Node(instance in=reference to "VoltageBandwidth_ACV", "Visible"=FALSE)
        Property Node(instance in=reference to "Aperture Time_DCVR", "Visible"=FALSE)
        Property Node(instance in=reference to "String_ACC", "Visible"=FALSE)
        Property Node(instance in=reference to "String_ACV", "Visible"=FALSE)
        Property Node(instance in=reference to "String_DCVR", "Visible"=FALSE)
        Property Node(instance in=reference to "Auto Range_ACV", "Visible"=FALSE)
        Event Data() -> ("Old Value"=w58, "New Value"=w59)
        Property Node(instance in=reference to "VoltageAC_control", "Visible"=w59, "Value"=FALSE)
        Property Node(instance in=reference to "VoltageAC_indicator", "Visible"=w58)
        Property Node(instance in=reference to "VoltageDC_indicator", "Visible"=w58)
        Property Node(instance in=reference to "VoltageDC_control", "Visible"=w59, "Value"=FALSE)
        Property Node(instance in=reference to "CurrentAC_control", "Visible"=w59, "Value"=FALSE)
        Property Node(instance in=reference to "TerminalType_DCC", "Visible"=TRUE)
        Property Node(instance in=reference to "CurrentDC_indicator", "Visible"=w59)
        Property Node(instance in=reference to "Auto Range_DCC", "Visible"=TRUE)
        Property Node(instance in=reference to "CurrentDC_control", "Visible"=w58)
        Property Node(instance in=reference to "Manual Range_DCC", "Visible"=TRUE)
        Property Node(instance in=reference to "CurrentAC_indicator", "Visible"=w58)
        Property Node(instance in=reference to "Aperture_DCC", "Visible"=TRUE)
        Property Node(instance in=reference to "Aperture NPLC_DCC", "Visible"=TRUE)
        Property Node(instance in=reference to "Aperture Time_DCC", "Visible"=TRUE)
        Property Node(instance in=reference to "Auto Zero_DCC", "Visible"=TRUE)
        w1 = default
      }
      on "Aperture NPLC_DCC" Value changed; "Aperture Time_DCC" Value changed; "Aperture_DCC" Value changed; "Auto Range_DCC" Value changed; "Auto Zero_DCC" Value changed; "Manual Range_DCC" Value changed; "TerminalType_DCC" Value changed {
        Property Node(instance in=reference to "Aperture_DCC") -> ("Value"=w60)
        Not(x=w60) -> w61
        Property Node(instance in=reference to "Aperture NPLC_DCC", "Disabled"=w61) -> ("Value"=w62)
        Property Node(instance in=reference to "Aperture Time_DCC", "Disabled"=w60) -> ("Value"=w63)
        Quotient And Remainder(x=w63, y=2e-06) -> (floor(x/y)=w64, x-y*floor(x/y)=w65)
        Multiply(w65, 1000000) -> w66
        Round To Nearest(number=w66) -> w67
        To Signed 32 Bit Integer(number=w67) -> w68
        case (w68) {
          frame 0, Default {
            Multiply(2e-06, w64) -> w69
          }
          frame 1 {
            Multiply(2e-06, w64) -> w69
          }
          frame 2 {
            Add(1, w64) -> w70
            Multiply(2e-06, w70) -> w69
          }
        }
        case (w60) {
          frame False, Default {
            Format Into String(formatString="%_6ps", initString="Aperture Time: ", w69) -> w71
          }
          frame True {
            Format Into String(formatString="%#gPLC", initString="Aperture NPLC: ", w62) -> w71
          }
        }
        Property Node(instance in=reference to "Auto Range_DCC") -> ("Value"=w72)
        Property Node(instance in=reference to "Manual Range_DCC", "Disabled"=w72) -> ("Value"=w73)
        case (w72) {
          frame False, Default {
            Format Into String(formatString="%.0pV", initString="Range: ", w73) -> w74
          }
          frame True {
            w74 = "Range: Auto"
          }
        }
        Property Node(instance in=reference to "Auto Zero_DCC") -> ("Value"=w75)
        case (w75) {
          frame False, Default {
            w76 = "Auto Zero: Off"
          }
          frame True {
            w76 = "Auto Zero: On"
          }
        }
        Property Node(instance in=reference to "TerminalType_DCC") -> ("Value"=w77)
        Format Into String(formatString="%.0pA", initString="Terminal: ", w77) -> w78
        Concatenate Strings("Your settings:", "\r\n", w74, "\r\n", w71, "\r\n", w78, "\r\n", w76) -> w79
        $String_DCC <- w79
        Property Node(instance in=reference to "Aperture Time_DCC", "Value"=w69)
        w1 = default
      }
      on "CurrentAC_control" Value changed {
        # DCVRATIO VISIBILITY
        Property Node(instance in=reference to "DIG Option On/Off_DCVR", "Visible"=FALSE)
        # DCV VISIBILITY
        Property Node(instance in=reference to "DIG Option On/Off_DCV", "Visible"=FALSE)
        # DCC VISIBILITY
        Property Node(instance in=reference to "TerminalType_DCC", "Visible"=FALSE)
        # ACV VISIBILITY
        Property Node(instance in=reference to "Manual Range_ACV", "Visible"=FALSE)
        Property Node(instance in=reference to "Auto Impedance_DCVR", "Visible"=FALSE)
        Property Node(instance in=reference to "Auto Impedance_DCV", "Visible"=FALSE)
        Property Node(instance in=reference to "Auto Range_DCC", "Visible"=FALSE)
        Property Node(instance in=reference to "VoltageBandwidth_ACV", "Visible"=FALSE)
        Property Node(instance in=reference to "Manual Range_DCVR", "Visible"=FALSE)
        Property Node(instance in=reference to "Manual Range_DCV", "Visible"=FALSE, "Disabled"=TRUE)
        Property Node(instance in=reference to "Manual Range_DCC", "Visible"=FALSE)
        # TITLES VISIBILITY
        Property Node(instance in=reference to unnamed text, "Visible"=FALSE)
        Property Node(instance in=reference to "Aperture NPLC_DCVR", "Visible"=FALSE)
        Property Node(instance in=reference to "Aperture NPLC_DCV", "Visible"=FALSE)
        Property Node(instance in=reference to "String_ACV", "Visible"=FALSE)
        Property Node(instance in=reference to "Aperture_DCC", "Visible"=FALSE)
        Property Node(instance in=reference to unnamed text, "Visible"=FALSE)
        Property Node(instance in=reference to "Aperture_DCVR", "Visible"=FALSE)
        Property Node(instance in=reference to "Aperture_DCV", "Visible"=FALSE)
        Property Node(instance in=reference to "Auto Range_ACV", "Visible"=FALSE)
        Property Node(instance in=reference to "Aperture NPLC_DCC", "Visible"=FALSE)
        Property Node(instance in=reference to unnamed text, "Visible"=FALSE)
        Property Node(instance in=reference to "Auto Range_DCVR", "Visible"=FALSE)
        Property Node(instance in=reference to "Auto Range_DCV", "Visible"=FALSE)
        Property Node(instance in=reference to "Aperture Time_DCC", "Visible"=FALSE)
        Property Node(instance in=reference to unnamed text, "Visible"=FALSE)
        Property Node(instance in=reference to "DCV Ratio_todisable", "Visible"=FALSE)
        Property Node(instance in=reference to "DCV Ratio_toenable", "Visible"=FALSE)
        Property Node(instance in=reference to "Auto Zero_DCC", "Visible"=FALSE)
        Property Node(instance in=reference to "Aperture Time_DCVR", "Visible"=FALSE)
        Property Node(instance in=reference to "Aperture Time_DCV", "Visible"=FALSE)
        Property Node(instance in=reference to unnamed text, "Visible"=FALSE)
        Property Node(instance in=reference to "String_DCVR", "Visible"=FALSE)
        Property Node(instance in=reference to "String_DCV", "Visible"=FALSE)
        Property Node(instance in=reference to unnamed text, "Visible"=TRUE)
        Property Node(instance in=reference to "String_DCC", "Visible"=FALSE)
        Property Node(instance in=reference to "Auto Zero_DCV", "Visible"=FALSE)
        # ACC VISIBILITY
        Property Node(instance in=reference to "TerminalType_ACC", "Visible"=TRUE)
        Property Node(instance in=reference to "VoltageBandwidth_ACC", "Visible"=TRUE)
        Property Node(instance in=reference to "Manual Range_ACC", "Visible"=TRUE)
        Property Node(instance in=reference to "Auto Range_ACC", "Visible"=TRUE)
        Property Node(instance in=reference to "String_ACC", "Visible"=TRUE)
        Event Data() -> ("Old Value"=w80, "New Value"=w81)
        Property Node(instance in=reference to "CurrentDC_indicator", "Visible"=w80)
        Property Node(instance in=reference to "VoltageDC_indicator", "Visible"=w80)
        Property Node(instance in=reference to "VoltageDC_control", "Visible"=w81, "Value"=FALSE)
        Property Node(instance in=reference to "CurrentDC_control", "Visible"=w81, "Value"=FALSE)
        Property Node(instance in=reference to "CurrentAC_indicator", "Visible"=w81)
        Property Node(instance in=reference to "VoltageAC_control", "Visible"=w81, "Value"=FALSE)
        Property Node(instance in=reference to "VoltageAC_indicator", "Visible"=w80)
        Property Node(instance in=reference to "CurrentAC_control", "Visible"=w80)
        w1 = default
      }
      on "stop" Value changed; "Window" Close {
        w1 = TRUE
      }
      on "Auto Range_ACC" Value changed; "Manual Range_ACC" Value changed; "TerminalType_ACC" Value changed; "VoltageBandwidth_ACC" Value changed {
        Property Node(instance in=reference to "Auto Range_ACC") -> ("Value"=w82)
        Property Node(instance in=reference to "Manual Range_ACC", "Disabled"=w82) -> ("Value"=w83)
        case (w82) {
          frame False, Default {
            Format Into String(formatString="%.0pV", initString="Range: ", w83) -> w84
          }
          frame True {
            w84 = "Range: Auto"
          }
        }
        Property Node(instance in=reference to "VoltageBandwidth_ACC") -> ("Value"=w85)
        Format Into String(formatString="%.0pHz", initString="AC Filter: >", w85) -> w86
        Property Node(instance in=reference to "TerminalType_ACC") -> ("Value"=w87)
        Format Into String(formatString="%.0pA", initString="Terminal: ", w87) -> w88
        Concatenate Strings("Your settings:", "\r\n", w84, "\r\n", w86, "\r\n", w88) -> w89
        $String_ACC <- w89
        w1 = default
      }
    }
    $VoltageAC_indicator <- $VoltageAC_control
    $VoltageDC_indicator <- $VoltageDC_control
    $CurrentDC_indicator <- $CurrentDC_control
    stop if w1
  }
